# Dynamo graph VMC_WRK_WorksetRenamer.dyn (Dynamo 2.6.1.8786)

# group: [GET] WORKSETS
python_script_workset_collector = Python()  # unwired: IN[0]
# ---------- python_script_workset_collector.python (23 lines) ----------
import clr 
clr.AddReference("RevitNodes")

import Revit
clr.ImportExtensions(Revit.Elements)
clr.ImportExtensions(Revit.GeometryConversion)
clr.AddReference("RevitServices")
import RevitServices
from RevitServices.Persistence import DocumentManager
from RevitServices.Transactions import TransactionManager

clr.AddReference("RevitAPI")
import Autodesk
from Autodesk.Revit.DB import *

doc = DocumentManager.Instance.CurrentDBDocument
worksets = FilteredWorksetCollector(doc).OfKind(WorksetKind.UserWorkset).ToWorksets()

names = [workset.Name for workset in worksets]
names.sort()
ids = [workset.Id for workset in worksets]

OUT = worksets, names, ids
# ----------------------------------------
code_block = CodeBlock(x=python_script_workset_collector) { x[1]; }
python_script_workset_by_name = Python(IN[0]=code_block)  # "Python Script [WORKSET BY NAME - SORTED]"
# ---------- python_script_workset_by_name.python (27 lines) ----------
import clr

clr.AddReference("RevitServices")
import RevitServices
from RevitServices.Persistence import DocumentManager

clr.AddReference("RevitAPI")
import Autodesk
from Autodesk.Revit.DB import *

doc = DocumentManager.Instance.CurrentDBDocument

worksetname = IN[0] if isinstance(IN[0],list) else [IN[0]]
getworkset = []
ids = []

uworksets = FilteredWorksetCollector(doc).OfKind(WorksetKind.UserWorkset).ToWorksets()

for workset in worksetname :
# Get Revit Workset
	getworkset.append(next((ws for ws in uworksets if ws.Name.lower() == workset.lower()), None))
#Get Workset IDs
	ids.append(next((ws.Id.IntegerValue for ws in uworksets if ws.Name.lower() == workset.lower()), None))
# Get Workset Names
	names = [workset for workset in worksetname]
	
OUT = getworkset, ids, names
# ----------------------------------------
code_block_2 = CodeBlock(x=python_script_workset_by_name) { x[0]; }
current_worksets = Watch(code_block)  # graph output

# group: [IN] EXCEL RENAMED
file_path = Filename("..\..\..\..\..\..\..\..\..\Documents\WORKSETS.xlsx")  # graph input
file_from_path = FileObject(path=file_path)
code_block_3 = CodeBlock { "REVISED"; }
boolean = BoolSelector(true)
boolean_2 = BoolSelector(false)
importExcel = Data.ImportExcel(file=file_from_path, sheetName=code_block_3, readAsStrings=boolean, showExcel=boolean_2)
flatten = List.Flatten(list=importExcel)
code_block_4 = CodeBlock { 1; }
dropItems = List.DropItems(list=flatten, amount=code_block_4)

# group: SET WORKSET NAME
python_script_rename_workset = Python(IN[0]=code_block_2, IN[1]=dropItems)  # graph output; frozen
# ---------- python_script_rename_workset.python (29 lines) ----------
import clr

clr.AddReference("RevitServices")
import RevitServices
from RevitServices.Persistence import DocumentManager
from RevitServices.Transactions import TransactionManager

clr.AddReference("RevitAPI")
import Autodesk
from Autodesk.Revit.DB import *

doc = DocumentManager.Instance.CurrentDBDocument
uidoc = DocumentManager.Instance.CurrentUIDocument

worksets = UnwrapElement(IN[0])
names = IN[1]

TransactionManager.Instance.EnsureInTransaction(doc)

for workset, name in zip(worksets,names):
	if isinstance(workset.Id, int):
		WorksetTable.RenameWorkset(doc,WorksetId(workset.Id), name)
	else:
		WorksetTable.RenameWorkset(doc,workset.Id, name)

TransactionManager.Instance.TransactionTaskDone()
names = [workset.Name for workset in worksets]

OUT = worksets, names
# ----------------------------------------

renamed_worksets = Watch(dropItems)  # graph output
